# Grasshopper definition regular tetrahedron.gh (Grasshopper 1.0.7)

number_slider = Slider(7, range=0..100)
a_x_y = GhPythonScript(x=number_slider, y=Slider(2, range=0..100))  # -> out, a
# ---------- a_x_y: Python ----------
__author__ = "sator"
__version__ = "2023.04.26"

import rhinoscriptsyntax as rs

a = x * y
# ---------- end a_x_y ----------
a_x_y_2 = GhPythonScript(x=Slider(1, range=0..100), y=Slider(5, range=0..100))  # -> out, a
# ---------- a_x_y_2: Python ----------
__author__ = "sator"
__version__ = "2023.04.26"

import rhinoscriptsyntax as rs

a = x / y
# ---------- end a_x_y_2 ----------
radgrid = Radial(Plane=PlaneXY(0, 0, 0), Size=number_slider, ExtentR=Slider(1, range=0..100), ExtentP=Slider(5, range=0..100))  # -> Cells, Points; disabled
panel = Panel(radgrid.Points)
vec = VectorXYZ(XComponent=Slider(0, range=0..50), YComponent=Slider(0, range=0..50), ZComponent=Slider(0, range=0..50))  # -> Vector, Length
pi = Pi(Factor=a_x_y_2.a)
sqrt = SquareRoot(Value=Slider(2, range=0..50))
division = Division(A=sqrt, B=Slider(4, range=0..50))
item = ListItem(List=radgrid.Points, Index=Slider(0, range=0..100), Wrap=True)
panel_2 = Panel(item)
vec_2 = VectorXYZ(XComponent=Slider(0, range=0..50), YComponent=Slider(0, range=0..50), ZComponent=division)  # -> Vector, Length
rotate = Rotate(Geometry=radgrid.Points, Angle=pi, Plane=PlaneXY(0, 0, 0))  # -> Geometry, Transform
X = UnitX(Factor=1)
Y = UnitY(Factor=1)
Z = UnitZ(Factor=1)
_4face = GhPythonScript()  # -> out, a, b
# ---------- _4face: Python ----------
__author__ = "sator"
__version__ = "2023.04.28"

import rhinoscriptsyntax as rs
import math

faces = []
triangle_points = []

for i in range(0, 3):
    angle = 2.0 * math.pi / 3 * i
    triangle_points.append(rs.CreatePoint([math.cos(angle), math.sin(angle), 0]))

triangle_points.append(rs.CreatePoint([0, 0, math.sqrt(2)]));


faces.append(rs.AddSrfPt([triangle_points[2], triangle_points[1], triangle_points[0]]))
faces.append(rs.AddSrfPt([triangle_points[0], triangle_points[1], triangle_points[3]]))
faces.append(rs.AddSrfPt([triangle_points[1], triangle_points[2], triangle_points[3]]))
faces.append(rs.AddSrfPt([triangle_points[2], triangle_points[0], triangle_points[3]]))

a = faces
# ---------- end _4face ----------
ln = Line(StartPoint=X, EndPoint=vec.Vector)
panel_3 = Panel(rotate.Geometry)
vec_3 = VectorXYZ(XComponent=Slider(0, range=0..50), YComponent=Slider(0, range=0..50), ZComponent=Slider(0, range=0..50))  # -> Vector, Length
ln_2 = Line(StartPoint=Y, EndPoint=vec.Vector)
ln_3 = Line(StartPoint=Z, EndPoint=vec.Vector)
base_hexagon = SimpleMesh(Brep=radgrid.Cells)  # disabled
subtraction = Subtraction(A=vec_3.Vector, B=vec_2.Vector)
move = Move(Geometry=_4face.a, Motion=subtraction)  # -> Geometry, Transform
origin = VectorXYZ(XComponent=Slider(0, range=0..10), YComponent=Slider(0, range=0..10), ZComponent=Slider(0, range=0..10))  # -> Vector, Length
scale = Scale(Geometry=rotate.Geometry, Center=origin.Vector, Factor=Slider(2, range=0..10))  # -> Geometry, Transform
rad = Radians(Degrees=Slider(180, range=0..360))
rotax = RotateAxis(Geometry=move.Geometry, Angle=rad, Axis=ln)  # -> Geometry, Transform
vec2pt = Vector2Pt(PointA=scale.Geometry, PointB=origin.Vector, Unitize=False)  # -> Vector, Length
rad_2 = Radians(Degrees=Slider(125, range=0..360))
panel_4 = Panel(vec2pt.Vector)
python = GhPythonScript(x=base_hexagon, y=vec2pt.Vector)  # -> out, a
# ---------- python: Python ----------
__author__ = "sator"
__version__ = "2023.04.26"

import rhinoscriptsyntax as rs

a = []

a.append(x)

for p in y:
    print p
    
print "len(y) ={}".format(len(y))
for i in range(int((len(y) / 3))):
    print "i={}".format(i)
    print "({},{},{})".format(y[i])
        
    
    #rs.TransformObject(x, rs.XformTranslation(p))
    #a.append(x)
# ---------- end python ----------
rotax_2 = RotateAxis(Geometry=rotax.Geometry, Angle=rad_2, Axis=ln_2)  # -> Geometry, Transform
pcen = PolygonCenter(Polyline=rotax_2.Geometry)  # -> CenterV, CenterE, CenterA
del = DelaunayMesh(Points=reverse(pcen.CenterV), Plane=PlaneXY(0, 0, 0))
del_2 = DelaunayMesh(Points=pcen.CenterV, Plane=PlaneXY(0, 0, 0))
merge = Merge(Data1=del, Data2=del_2)
mjoin = MeshJoin(Meshes=merge)
faceb = FaceBoundaries(Mesh=mjoin)
boundary = BoundarySurfaces(Edges=faceb)
bvol = BoundaryVolume(Boundaries=rotax_2.Geometry)
bvol_2 = BoundaryVolume(Boundaries=boundary)
scale_2 = Scale(Geometry=bvol_2, Center=vec.Vector, Factor=Slider(6.729, range=0.001..10))  # -> Geometry, Transform
sint = SolidIntersection(BrepsA=bvol, BrepsB=scale_2.Geometry)
edges = BrepEdges(Brep=sint)  # -> Naked, Interior, NonManifold
del_3 = DelaunayMesh(Plane=PlaneXY(0, 0, 0))
divlength = DivideLength(Curve=edges.Interior, Length=Slider(0.64, range=0.001..10))  # -> flatten(Points), Tangents, Parameters
pcen_2 = PolygonCenter()  # -> CenterV, CenterE, CenterA
edgesrf = EdgeSurface()
con = DelaunayEdges(Points=pcen_2.CenterE, Plane=PlaneXY(0, 0, 0))  # -> Connectivity, Edges
