# Grasshopper definition surface_area.gh (Grasshopper 1.0.7)

animation_sequence = Slider(0.578471, range=0..1)
panel = Panel("2")
sph = Sphere(Base=PlaneXY(0, 0, 0), Radius=1)
_2º = PowerOf2(Value=Slider(12, range=-1..20))
vec = VectorXYZ(XComponent="25", YComponent="25", ZComponent="25")  # -> Vector, Length
move = Move(Geometry=sph, Motion=vec.Vector)  # -> Geometry, Transform
python = GhPythonScript(x=animation_sequence)  # -> out; disabled
# ---------- python: Python ----------
__author__ = "sator"
__version__ = "2023.07.07"

import rhinoscriptsyntax as rs
if x == 0:
    path = "result.txt"
    f = open(path, "w")
    f.write(str(0))
    f.close()
    
a = "do update!"
# ---------- end python ----------
z_range_min = Number("0")
z_range_max = Number("50")
domain_max = Number("50")
domain_min = Number("0")
dom = ConstructDomain(DomainStart=domain_min, DomainEnd=domain_max)
split_num = Number(_2º)
multiplication = Multiplication(A=animation_sequence, B=split_num)
multiplication_2 = Multiplication(A=multiplication, B=split_num)
multiplication_3 = Multiplication(A=animation_sequence, B=split_num)
mod = Modulus(A=multiplication_2, B=split_num)
round = Round(Number=multiplication_3)  # -> Nearest, Floor, Ceiling
round_2 = Round(Number=mod)  # -> Nearest, Floor, Ceiling
y = Number(round_2.Floor)
x = Number(round.Floor)
range = Range(Domain=dom, Steps=split_num)
range_2 = Range(Domain=dom, Steps=split_num)
scale = Scale(Geometry=move.Geometry, Center=vec.Vector, Factor="20")  # -> Geometry, Transform
multiplication_4 = Multiplication()
vec_2 = VectorXYZ(XComponent="5", YComponent="5", ZComponent="5")  # -> Vector, Length
rectangle = Rectangle(Plane=PlaneXY(0, 0, 0), XSize="40", YSize="40", Radius=0)  # -> Rectangle, Length
item = ListItem(List=range_2, Index=y, Wrap=True)
panel_2 = Panel(x)
item_2 = ListItem(List=range, Index=x, Wrap=True)
move_2 = Move(Geometry=rectangle.Rectangle, Motion=vec_2.Vector)  # -> Geometry, Transform
number_slider = Slider(24, range=0..24)
num = Number(graft(item_2))
srf = Surface(move_2.Geometry)
panel_3 = Panel(y)
vec_3 = VectorXYZ(XComponent=num, YComponent=item, ZComponent=0)  # -> flatten(Vector), Length
subtraction = Subtraction(A=domain_min, B=domain_max)
pcen = PolygonCenter(Polyline=srf)  # -> CenterV, CenterE, CenterA
sdivide = DivideSurface(Surface=srf, UCount=number_slider, VCount=number_slider)  # -> flatten(Points), Normals, Parameters
abs = Absolute(Value=subtraction)
ln = Line(StartPoint=pcen.CenterV, EndPoint=sdivide.Points)
division = Division(A=abs, B=split_num)
domain_width = Number(division)
len = Length(Curve=ln)  # -> simplify(Length)
vec_4 = Vector(graft(vec_3.Vector))
panel_4 = Panel(len)
panel_5 = Panel(vec_4)
bnd = Bounds(Numbers=len)
multiplication_5 = Multiplication(A=Slider(3, range=0..24), B="360")
remap = RemapNumbers(Value=len, Source=bnd, Target=multiplication_5)  # -> Mapped, Clipped
xy = XYPlane(Origin=Point(0, 0, 0))
rectangle_2 = Rectangle(Plane=xy, XSize=domain_width, YSize=domain_width, Radius=0)  # -> Rectangle, Length
rad = Radians(Degrees=remap.Mapped)
boundary = BoundarySurfaces(Edges=rectangle_2.Rectangle)
sin = Sine(Value=rad)
move_3 = Move(Geometry=boundary, Motion=vec_4)  # -> Geometry, Transform
z_range_min_2 = Number(z_range_min)
z_range_max_2 = Number(z_range_max)
multiplication_6 = Multiplication(A=sin, B=Slider(2, range=0..500))
Z = UnitZ(Factor=multiplication_6)
subtraction_2 = Subtraction(A=z_range_min_2, B=z_range_max_2)
move_4 = Move(Geometry=sdivide.Points, Motion=Z)  # -> flatten(Geometry), Transform
addition = Addition(A=number_slider, B="1")
abs_2 = Absolute(Value=subtraction_2)
z_range_width = Number(abs_2)
srfgrid = SurfaceFromPoints(Points=move_4.Geometry, UCount=addition, Interpolate=False)
Z_2 = UnitZ(Factor=abs_2)
extr = Extrude(Base=move_3.Geometry, Direction=Z_2)
srf_2 = Surface(scale.Geometry)
preview = CustomPreview(Geometry=srf_2, Material=ColourSwatch(SwatchColor=RGBA(29, 230, 194, 80)))
bvol = BoundaryVolume(Boundaries=extr)
swatch = ColourSwatch(SwatchColor=RGB(179, 72, 194))  # disabled
sint = SolidIntersection(BrepsA=srf_2, BrepsB=bvol)
preview_2 = CustomPreview(Geometry=bvol, Material=swatch)  # disabled
null = NullItem(Item=sint)  # -> NullFlags, InvalidFlags, Description
and = GateAnd(A=null.NullFlags, B=null.InvalidFlags)
dispatch = Dispatch(List=sint, DispatchPattern=and)  # -> ListA, ListB
brep = Brep(flatten(dispatch.ListB))
debrep = DeconstructBrep(Brep=brep)  # -> Faces, Edges, Vertices
lng = ListLength(List=debrep.Faces)
panel_6 = Panel(lng)
equals = Equality(FirstNumber=lng, SecondNumber="6")  # -> Equality, Inequality
dispatch_2 = Dispatch(List=debrep.Faces, DispatchPattern=equals.Equality)  # -> ListA, ListB
srf_3 = Surface(flatten(dispatch_2.ListA))
mesh = Mesh(srf_3)
demesh = DeconstructMesh(Mesh=mesh)  # -> Vertices, Faces, Colours, Normals
facen = FaceNormals(Mesh=srf_3)  # -> Centers, Normals
panel_7 = Panel("{0}")
Z_3 = UnitZ(Factor=1)
dprod = DotProduct(VectorA=demesh.Normals, VectorB=Z_3, Unitize=False)
avr = Average(Input=dprod)  # -> flatten(ArithmeticMean)
abs_3 = Absolute(Value=avr)
smaller = SmallerThan(FirstNumber=abs_3, SecondNumber="0.001")  # -> SmallerThan, OrEqualTo
dispatch_3 = Dispatch(List=srf_3, DispatchPattern=smaller.SmallerThan)  # -> ListA, ListB
srf_4 = Surface(dispatch_3.ListB)
mesh_2 = Mesh(srf_4)
demesh_2 = DeconstructMesh(Mesh=mesh_2)  # -> Vertices, Faces, Colours, Normals
pdecon = Deconstruct(Point=demesh_2.Vertices)  # -> XComponent, YComponent, ZComponent
vec_5 = VectorXYZ(XComponent=pdecon.XComponent, YComponent=pdecon.YComponent, ZComponent=0)  # -> Vector, Length
z_range_width_2 = Number(z_range_width)
sort = SortList(Keys=vec_5.Length, ValuesA=demesh_2.Vertices)  # -> Keys, ValuesA
vec_6 = VectorXYZ(XComponent=z_range_width_2, YComponent=0, ZComponent=0)  # -> Vector, Length
Z_4 = UnitZ(Factor=1)  # disabled
X = UnitX(Factor=1)  # disabled
vec_7 = VectorXYZ(XComponent=0, YComponent=z_range_width_2, ZComponent=0)  # -> Vector, Length
vec_8 = VectorXYZ(XComponent=0, YComponent=0, ZComponent=0)  # -> Vector, Length; disabled
devec = DeconstructVector(Vector=demesh_2.Vertices)  # -> XComponent, YComponent, ZComponent
pl_3pt = Plane3Pt(PointA=Z_4, PointB=X, PointC=vec_8.Vector)  # disabled
panel_8 = Panel("1")  # disabled
lng_2 = ListLength(List=sort.ValuesA)
vec_9 = VectorXYZ(XComponent=devec.XComponent, YComponent=devec.YComponent, ZComponent=0)  # -> Vector, Length
subtraction_3 = Subtraction(A=lng_2, B="1")
planesrf = PlaneSurface(Plane=pl_3pt, XSize=panel_8, YSize=panel_8)  # disabled
X_2 = UnitX(Factor=1)  # disabled
panel_9 = Panel("100")  # disabled
item_3 = ListItem(List=sort.ValuesA, Index=subtraction_3, Wrap=True)
item_4 = ListItem(List=sort.ValuesA, Index=0, Wrap=True)
addition_2 = Addition(A=item_4, B=vec_7.Vector)
addition_3 = Addition(A=item_4, B=vec_6.Vector)
vec_10 = VectorXYZ(XComponent=0, YComponent=0, ZComponent=0)  # -> Vector, Length; disabled
multiplication_7 = Multiplication(A=X_2, B=panel_9)  # disabled
subtraction_4 = Subtraction(A=vec_9.Vector, B=addition_3)
panel_10 = Panel("10")  # disabled
ln_2 = Line(StartPoint=multiplication_7, EndPoint=vec_10.Vector)  # disabled
subtraction_5 = Subtraction(A=vec_9.Vector, B=addition_2)
vlen = VectorLength(Vector=subtraction_4)
vlen_2 = VectorLength(Vector=subtraction_5)
sort_2 = SortList(Keys=vlen, ValuesA=demesh_2.Vertices)  # -> Keys, ValuesA
sort_3 = SortList(Keys=vlen_2, ValuesA=demesh_2.Vertices)  # -> Keys, ValuesA
item_5 = ListItem(List=sort_3.ValuesA, Index=0, Wrap=True)
item_6 = ListItem(List=sort_2.ValuesA, Index=0, Wrap=True)
addition_4 = Addition(A=item_6, B=item_5)
subtraction_6 = Subtraction(A=addition_4, B=item_4)
subtraction_7 = Subtraction(A=item_6, B=item_4)
subtraction_8 = Subtraction(A=item_5, B=item_4)
points = PointList(Points=subtraction_6)
ln_3 = Line(StartPoint=item_5, EndPoint=item_4)
ln_4 = Line(StartPoint=item_6, EndPoint=item_4)
merge = Merge(Data1=item_4, Data2=item_6, Data3=subtraction_6, Data4=item_5)
xprod = CrossProduct(VectorA=subtraction_7, VectorB=subtraction_8, Unitize=False)  # -> Vector, Length
conmesh = ConstructMesh(Vertices=merge, Faces={A=0, B=1, C=2, D=3})
swatch_2 = ColourSwatch(SwatchColor=RGB(255, 0, 183))
num_2 = Number(flatten(xprod.Length))
preview_3 = CustomPreview(Geometry=ln_4, Material=swatch_2)
ma = MassAddition(Input=num_2)  # -> Result, PartialResults
python_2 = GhPythonScript(x=ma.Result, update_point=python)  # -> out, a; disabled
# ---------- python_2: Python ----------
__author__ = "sator"
__version__ = "2023.07.07"

import rhinoscriptsyntax as rs

path = "result.txt"
f = open(path, 'r')
a = f.read()
f.close()

a = "this vertex area = " + str(x) + "\n sum = " + a
# ---------- end python_2 ----------
textsrf = TextOnSurface(Text=python_2.a, Font="Sans Bold:no Italic:no", Height=panel_10, Depth=0.4, BaseLine=ln_2, BaseSurface=planesrf)  # disabled
preview_4 = CustomPreview(Geometry=ln_3, Material=swatch_2)
preview_5 = CustomPreview(Geometry=conmesh, Material=ColourSwatch(SwatchColor=RGB(251, 164, 87)))
python_3 = GhPythonScript(result=ma.Result)  # -> out, a
# ---------- python_3: Python ----------
__author__ = "sator"
__version__ = "2023.07.07"

import rhinoscriptsyntax as rs


path = 'result.txt'
print result
if result is not None:
    f = open(path, 'r')
    prev = float(f.read())
    f.close()
    
    f = open(path, 'w')
    f.write(str(prev + result))
    f.close()
# ---------- end python_3 ----------
panel_11 = Panel(ma.Result)
division_2 = Division(A=ma.Result, B="2")
panel_12 = Panel(division_2)
